# Grasshopper definition continuum_robot.gh (Grasshopper 1.0.8)
# plug-ins: Cushion.Components

# ----
# Body/Tendon
# Parameters
twist = Slider(0, range=0..1)
tendon_offset = Slider(0.74, range=0.01..1)
radius = Slider(8, range=0..100)
length = Slider(100, range=0..100)

# ----
# Tendon Paths
panel = Panel("""0
120
240""")
construct_domain = ConstructDomain(DomainStart=0, DomainEnd=1)
multiplication = Multiplication(A=radius, B=tendon_offset)
range = Range(Domain=construct_domain, Steps=10)
expression = Expression(t=range, p=graft(panel), r=multiplication, k=twist, Expression="r * cos(2*pi*k*t + rad(p))")
expression_2 = Expression(t=range, p=graft(panel), r=multiplication, k=twist, Expression="r * sin(2*pi*k*t + rad(p))")
expression_3 = Expression(t=range, L=length, Expression="L*t")
construct_point = ConstructPoint(XCoordinate=expression, YCoordinate=expression_2, ZCoordinate=expression_3)

# ----
# Run/Refresh
# Results
refresh_sofapreview = Button()
refresh_sofaresults = Button()
refresh_sofashape = Button()
write_sofascene = BooleanToggle(True)
runsofa = Button()
body_name = Panel("arm")

# ----
# Set Repository
# Set runSofa Location
# Set Project Directory
repository = Panel("C:\Users\YOU\Documents\sofa-gh")
project_directory = Panel("C:\Users\YOU\Documents\sofa_projects\gripper")
runsofa_location = Panel("C:\SOFA\SOFA_v24.06.00_Win64")

# ----
# Monitor Points
point = Point(Point(0, 0, 0))
line_sdl = LineSDL(Start=point, Direction=Vector(0, 0, 1), Length=length)
divide_curve = DivideCurve(Curve=line_sdl, Count=10, Kinks=False)  # -> Points, Tangents, Parameters

# ----
# Create Body
cylinder = Cylinder(Base=PlaneXY(0, 0, 0), Radius=radius, Length=length)
cap_holes = CapHoles(Brep=cylinder)
quad_remesh_settings = QuadRemeshSettings(TargetCount=1000, AdaptiveSize=0, AdaptiveCount=False, HardEdges=False, SeamEdges=0, Symmetry=0, GuideCurves=0)
quad_remesh = QuadRemesh(Geometry=cap_holes, Settings=quad_remesh_settings)

# ----
# Define fixation
number_slider = Slider(2, range=0..10)
number_slider_2 = Slider(15, range=0..100)
point_2 = Point(Point(0, 0, 2))
center_box = CenterBox(Base=point_2, X=number_slider_2, Y=number_slider_2, Z=number_slider)

panel_2 = Panel("""1
2
3""")
tendon_value_type = Panel("force")
panel_3 = Panel("""0,0,-5
0,0,-5
0,0,-5""")

# ----
# Tendon Profiles
panel_4 = Panel("""0
1000
0""")
panel_5 = Panel("""1
1.5
2""")
panel_6 = Panel("""2
2.5
3""")
panel_7 = Panel("""0
0.5
1""")
entwine = Entwine(Branch00=panel_4, Branch01=panel_4, Branch02=panel_4, FlattenInputs=True)
entwine_2 = Entwine(Branch00=panel_7, Branch01=panel_5, Branch02=panel_6, FlattenInputs=True)
sofaprofiles = SofaProfiles(Channels=panel_2, Times=entwine_2, Values=entwine)  # -> Profiles, Info

sofatendons = SofaTendons(Points=construct_point, Channels=panel_2, ValueType=tendon_value_type, PullPoints=panel_3)  # -> Tendons, Information
young_s_modulus = Slider(100, range=10..100)
meshsize = Slider(0.6, range=0..1)
nu = Slider(0.4, range=0.1..1)
mass = Slider(0.03, range=0.01..0.5)
N = Slider(10, range=0..10)
sofabody = SofaBody(
    Geometry=quad_remesh,
    BodyName=body_name,
    YoungsModulus=young_s_modulus,
    PoissonRatio=nu,
    Mass=mass,
    MeshSize=meshsize,
    Tendons=sofatendons.Tendons,
    Fixations=center_box,
    MonitorPoints=divide_curve.Points,
    VisualGeometry=quad_remesh,
    ExportShapeN=N)
point_3 = Point(Point(0, 209.7928159, 68.21629944))
point_4 = Point(Point(0, -42, 39))
sofascene = SofaScene(
    Bodies=sofabody,
    Profiles=sofaprofiles.Profiles,
    CameraPosition=point_3,
    CameraLookAt=point_4,
    ProjectFolder=project_directory,
    RepoPath=repository,
    Write=write_sofascene)  # -> ScenePath, Info

# ----
# Preview for selected frame
frame = Slider(-1, range=-1..50)
sofashape = SofaShape(ScenePath=sofascene.ScenePath, BodyName=body_name, Frame=frame, RepoPath=repository, Refresh=refresh_sofashape)  # -> Mesh, FrameCount, Time, Info

sofarun = SofaRun(ScenePath=sofascene.ScenePath, SOFAFolder=runsofa_location, RepoPath=repository, Run=runsofa)
sofaresults = SofaResults(ScenePath=sofascene.ScenePath, BodyName=body_name, RepoPath=repository, Refresh=refresh_sofaresults)  # -> Info, Times, TrackPoints, FinalPoints, NodeForces, ActuationTimes, Pressures, CableNames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

# ----
# Preview for setup
sofapreview = SofaPreview(ScenePath=sofascene.ScenePath, RepoPath=repository, Refresh=refresh_sofapreview)  # -> Volumes, Cavities, Regions, Targets, TendonCurves, TendonChannels, MonitorPoints, FixationBoxes, Info

point_5 = Point(sofaresults.TrackPoints)
list_item = ListItem(List=point_5, Index=-1, Wrap=True)  # -> flatten(Item)
convex_hull_3d = ConvexHull3D(Points=list_item)  # -> Hull, Indices
