# Grasshopper definition simple_gripper(1).gh (Grasshopper 1.0.8)
# plug-ins: Pufferfish, Cushion.Components

tendon_offset = Slider(0.74, range=0.01..1)
radius = Slider(8, range=0..100)
length = Slider(100, range=0..100)
refresh_sofapreview = Button()
refresh_sofaresults = Button()
write_sofascene = BooleanToggle(True)
sofa_gui = BooleanToggle(True)
runsofa = Button()
# Set runSofa Location
tendon_value_type = Panel("force")
# Set Project Directory
project_directory = Panel("C:\Users\texley\OneDrive - Fondazione Istituto Italiano Tecnologia\3D Files\sofaGH\sofatest")
# Set Repository
repository = Panel("C:\Users\texley\OneDrive - Fondazione Istituto Italiano Tecnologia\3D Files\sofaGH\sofa-gh")
body_name = Panel("trunk")
runsofa_location = Panel("C:\SOFA\v24.06.00\bin")
cylinder = Cylinder(Base=PlaneXY(0, 0, 0), Radius=radius, Length=length)
multiplication = Multiplication(A=radius, B=tendon_offset)
point = Point(Point(0, 0, 0))
construct_point = ConstructPoint(XCoordinate=0, YCoordinate=multiplication, ZCoordinate=0)
cap_holes = CapHoles(Brep=cylinder)
membrane_thickness = Slider(1.5, range=0.1..2)
line_sdl = LineSDL(Start=point, Direction=Vector(0, 0, 1), Length=length)
inlet_length = Slider(7.25, range=0.1..10)
inlet_radius = Slider(4, range=0.1..8)
bladder_height = Slider(10.5, range=0.1..20)
bladder_diameter = Slider(12.5, range=0.1..25)
number_of_chambers = Slider(4, range=1..10)
neck_height = Slider(2, range=0.1..4)

# ----
# Define fixation
number_slider = Slider(2, range=0..10)
number_slider_2 = Slider(15, range=0..100)
point_2 = Point(Point(0, 0, 2))
center_box = CenterBox(Base=point_2, X=number_slider_2, Y=number_slider_2, Z=number_slider)

panel = Panel("""0
120
240""")
move_to_point = MoveToPoint(Geometry=line_sdl, PointA=point, PointB=construct_point)  # -> Moved, Vector, Transform
rotate = Rotate(Geometry=move_to_point.Moved, Angle=degrees(panel), Plane=PlaneXY(0, 0, 0))  # -> Geometry, Transform
divide_curve = DivideCurve(Curve=line_sdl, Count=10, Kinks=False)  # -> Points, Tangents, Parameters
quad_remesh_settings = QuadRemeshSettings(TargetCount=1000, AdaptiveSize=0, AdaptiveCount=False, HardEdges=False, SeamEdges=0, Symmetry=0, GuideCurves=0)
divide_curve_2 = DivideCurve(Curve=rotate.Geometry, Count=10, Kinks=False)  # -> Points, Tangents, Parameters
cluster = Cluster(
    membrane_thickness=membrane_thickness,
    inlet_radius=inlet_radius,
    inlet_length=inlet_length,
    bladder_height=bladder_height,
    bladder_diameter=bladder_diameter,
    neck_height=neck_height,
    number_of_chambers=number_of_chambers)  # -> void_stp, for_membrane_stp, bladder_stp, bladder_surface, result_2
quad_remesh = QuadRemesh(Geometry=cap_holes, Settings=quad_remesh_settings)
panel_2 = Panel("""0,0,-5
0,0,-5
0,0,-5""")
panel_3 = Panel("""1
2
3""")
panel_4 = Panel("""0
800
0""")
panel_5 = Panel("""1
1.5
2""")
panel_6 = Panel("""2
2.5
3""")
panel_7 = Panel("""0
0.5
1""")
sofatendons = SofaTendons(Pts=divide_curve_2.Points, Channels=panel_3, ValueType=tendon_value_type, PullPoints=panel_2)  # -> Tendons, Info
entwine = Entwine(Branch00=panel_4, Branch01=panel_4, Branch02=panel_4, FlattenInputs=True)
entwine_2 = Entwine(Branch00=panel_7, Branch01=panel_5, Branch02=panel_6, FlattenInputs=True)
young_s_modulus = Slider(100, range=10..100)
nu = Slider(0.4, range=0.1..1)
mass = Slider(0.03, range=0.01..0.5)
meshsize = Slider(0.6, range=0..1)
sofaprofiles = SofaProfiles(Channels=panel_3, Times=entwine_2, Values=entwine)  # -> Profiles, Info
sofabody = SofaBody(
    Geo=quad_remesh,
    Name=body_name,
    E=young_s_modulus,
    Nu=nu,
    Mass=mass,
    MeshSize=meshsize,
    Tendons=sofatendons.Tendons,
    Fixations=center_box,
    MonitorPts=divide_curve.Points,
    VisualGeo=quad_remesh,
    ExportShape=Slider(10, range=0..10))
point_3 = Point(Point(0, -42, 39))
point_4 = Point(Point(0, 209.7928159, 68.21629944))
sofascene = SofaScene(
    Bodies=sofabody,
    Profiles=sofaprofiles.Profiles,
    CamPos=point_4,
    CamTarget=point_3,
    ProjDir=project_directory,
    Repo=repository,
    Write=write_sofascene)  # -> ScenePath, Info
sofaresults = SofaResults(ScenePath=sofascene.ScenePath, BodyName=body_name, Repo=repository, Refresh=refresh_sofaresults)  # -> Info, Times, Points, LastPts, PTimes, Pressures, CableNames, CableDisp, CableForce
frame = Slider(-1, range=-1..50)
refresh_sofashape = BooleanToggle(True)
point_5 = Point(sofaresults.Points)
list_item = ListItem(List=sofaresults.Points, Index=-1, Wrap=True)  # -> flatten(Item)
sofapreview = SofaPreview(ScenePath=sofascene.ScenePath, Repo=repository, Refresh=refresh_sofapreview)  # -> Volumes, Cavities, Regions, Targets, TendonCrvs, TendonChs, MonitorPts, FixBoxes, Info
# Preview for selected frame
sofashape = SofaShape(ScenePath=sofascene.ScenePath, BodyName=body_name, Frame=frame, Repo=repository, Refresh=refresh_sofashape)  # -> Mesh, NFrames, Time, Info
sofarun = SofaRun(ScenePath=sofascene.ScenePath, SofaRoot=runsofa_location, Repo=repository, Gui=sofa_gui, Run=runsofa)
convex_hull_3d = ConvexHull3D(Points=list_item)  # -> Hull, Indices
# Preview for setup
panel_8 = Panel(sofarun)

# ==== cluster Cluster
inlet_radius = ClusterInput()
inlet_length = ClusterInput()
bladder_diameter = ClusterInput()
bladder_height = ClusterInput()
neck_height = ClusterInput()
number_of_chambers = ClusterInput()
inlet_radius_2 = Number(inlet_radius)
inlet_length_2 = Number(inlet_length)
bladder_diameter_2 = Number(bladder_diameter)
bladder_height_2 = Number(bladder_height)
neck_height_2 = Number(neck_height)
number_of_chambers_2 = Number(number_of_chambers)
unit_z = UnitZ(Factor=inlet_length_2)
line_sdl = LineSDL(Start=Point(0, 0, 0), Direction=unit_z, Length=inlet_length_2)
addition = Addition(A=inlet_length_2, B=bladder_height_2)
line_sdl_2 = LineSDL(Start=unit_z, Direction=Vector(0, 0, 1), Length=bladder_height_2)
divide_curve = DivideCurve(Curve=line_sdl, Count=Slider(10, range=1..10), Kinks=False)  # -> Points, Tangents, Parameters
unit_z_2 = UnitZ(Factor=addition)
construct_domain = ConstructDomain(DomainStart=inlet_radius_2, DomainEnd=bladder_diameter_2)
deconstruct = Deconstruct(Point=divide_curve.Points)  # -> XComponent, YComponent, ZComponent
divide_curve_2 = DivideCurve(Curve=line_sdl_2, Count=Slider(7, range=0..100), Kinks=False)  # -> Points, Tangents, Parameters
line_sdl_3 = LineSDL(Start=unit_z_2, Direction=Vector(0, 0, 1), Length=neck_height_2)
construct_point = ConstructPoint(XCoordinate=inlet_radius_2, YCoordinate=0, ZCoordinate=deconstruct.ZComponent)
construct_domain_2 = ConstructDomain(DomainStart=0, DomainEnd=inlet_radius_2)
rich_graph_mapper = RichGraphMapper(
    Values=divide_curve_2.Parameters,
    Source=Domain(0, 1),
    Target=construct_domain,
    Remap=False,
    x0=0,
    x1=1,
    y0=4,
    y1=12.5,
    Ox=0.5025906563,
    Oy=1,
    Px=0,
    Py=0,
    container_name="Parabola")
deconstruct_2 = Deconstruct(Point=divide_curve_2.Points)  # -> XComponent, YComponent, ZComponent
divide_curve_3 = DivideCurve(Curve=line_sdl_3, Count=Slider(3, range=0..100), Kinks=False)  # -> Points, Tangents, Parameters
addition_2 = Addition(A=bladder_height_2, B=neck_height_2)
rich_graph_mapper_2 = RichGraphMapper(
    Values=divide_curve_3.Parameters,
    Source=Domain(0, 1),
    Target=construct_domain_2,
    Remap=False,
    x0=0,
    x1=1,
    y0=0,
    y1=4,
    Ox=0.5,
    Oy=0.6885813475,
    Px=1,
    Py=1,
    container_name="Parabola")
deconstruct_3 = Deconstruct(Point=divide_curve_3.Points)  # -> XComponent, YComponent, ZComponent
construct_point_2 = ConstructPoint(XCoordinate=rich_graph_mapper, YCoordinate=0, ZCoordinate=deconstruct_2.ZComponent)
result = Subtraction(A=number_of_chambers_2, B=1)
series = Series(Start=0, Step=addition_2, Count=number_of_chambers_2)
construct_point_3 = ConstructPoint(XCoordinate=rich_graph_mapper_2, YCoordinate=0, ZCoordinate=deconstruct_3.ZComponent)
result_2 = ClusterOutput(result)
multiplication = Multiplication(A=series, B=Vector(0, 0, 1))
move = Move(Geometry=graft(construct_point_2), Motion=multiplication)  # -> Geometry, Transform
series_2 = Series(Start=0, Step=addition_2, Count=result)
multiplication_2 = Multiplication(A=series_2, B=Vector(0, 0, 1))
move_2 = Move(Geometry=graft(construct_point_3), Motion=multiplication_2)  # -> Geometry, Transform
merge = Merge(Data1=construct_point, Data2=move.Geometry, Data3=move_2.Geometry)  # -> flatten(AllPoints)
bounds = Bounds(Numbers=flatten(merge))
deconstruct_domain = DeconstructDomain(Domain=bounds)  # -> Start, End
addition_3 = Addition(A=deconstruct_domain.End, B=Slider(0.1, range=0..1))
construct_point_4 = ConstructPoint(XCoordinate=0.1, YCoordinate=0, ZCoordinate=addition_3)
merge_2 = Merge(Data1=move.Geometry, Data2=move_2.Geometry, Data3=construct_point_4)
number_slider = Slider(0.3, range=0..1)
merge_3 = Merge(Data1=merge, Data2=construct_point_4)
cull_duplicates = CullDuplicates(Points=flatten(merge_2), Tolerance=number_slider, CullMode=3)  # -> Points, Indices, Valence
cull_duplicates_2 = CullDuplicates(Points=flatten(merge_3), Tolerance=number_slider, CullMode=3)  # -> Points, Indices, Valence
number_slider_2 = Slider(4, range=1..5)
deconstruct_4 = Deconstruct(Point=cull_duplicates_2.Points)  # -> XComponent, YComponent, ZComponent
deconstruct_5 = Deconstruct(Point=cull_duplicates.Points)  # -> XComponent, YComponent, ZComponent
sort_list = SortList(Keys=deconstruct_4.ZComponent, ValuesValuesA=cull_duplicates_2.Points)  # -> Keys, ValuesValuesA
number_slider_3 = Slider(2, range=0..2)
sort_list_2 = SortList(Keys=deconstruct_5.ZComponent, ValuesValuesA=cull_duplicates.Points)  # -> Keys, ValuesValuesA
interpolate = Interpolate(Vertices=sort_list.ValuesValuesA, Degree=number_slider_2, Periodic=False, KnotStyle=number_slider_3)  # -> Curve, Length, Domain
interpolate_2 = Interpolate(Vertices=sort_list_2.ValuesValuesA, Degree=number_slider_2, Periodic=False, KnotStyle=number_slider_3)  # -> Curve, Length, Domain
membrane_thickness = ClusterInput()
revolution = Revolution(Curve=interpolate.Curve, Axis=Line((0, 0, 7.5), (0, 0, 17.5)), Domain=Domain(0, 6.283185307))
membrane_thickness_2 = Number(membrane_thickness)
revolution_2 = Revolution(Curve=interpolate_2.Curve, Axis=Line((0, 0, 7.5), (0, 0, 17.5)), Domain=Domain(0, 6.283185307))
cap_holes = CapHoles(Brep=revolution)
bladder_surface = ClusterOutput(revolution)
multiplication_3 = Multiplication(A=membrane_thickness_2, B=-1)
cap_holes_2 = CapHoles(Brep=revolution_2)
for_membrane_stp = ClusterOutput(cap_holes)
offset_surface = OffsetSurface(Surface=revolution_2, Distance=multiplication_3, Retrim=True)
remove_surface = RemoveSurface(B=cap_holes)
shell_polysurface = ShellPolysurface(Polysurface=cap_holes, Removal=remove_surface, Thickness=membrane_thickness_2, FaceMerge=Toggle(True))
cap_holes_3 = CapHoles(Brep=offset_surface)
void_stp = ClusterOutput(cap_holes_3)
bladder_stp = ClusterOutput(shell_polysurface)

# ==== cluster RemoveSurface
B = ClusterInput()

list = ValueList({"North": 0, "South": 1, "East": 2, "West": 3, "Top": 4, "Bottom": 5}, selected="Bottom")
debrep = DeconstructBrep(Brep=B)  # -> Faces, Edges, Vertices
Y = UnitY(Factor=1)
X = UnitX(Factor=1)
Z = UnitZ(Factor=1)
rev = Reverse(Vector=Z)
rev_2 = Reverse(Vector=Y)
rev_3 = Reverse(Vector=X)
evalsrf = EvaluateSurface(Surface=reparameterize(debrep.Faces), Point="0.5,0.5,0")  # -> Point, Normal, UDirection, VDirection, Frame
filter = StreamFilter(Gate=list, Stream0=Y, Stream1=rev_2, Stream2=X, Stream3=rev_3, Stream4=Z, Stream5=rev)
mindex = MemberIndex(Set=evalsrf.Normal, Member=filter)  # -> Index, Count
item = ListItem(List=debrep.Faces, Index=mindex.Index, Wrap=True)
preview = CustomPreview(Geometry=item, Material=ColourSwatch(SwatchColor=RGB(186, 223, 255)))

I = ClusterOutput(mindex.Index)
