# Grasshopper definition simple_gripper.gh (Grasshopper 1.0.8)
# plug-ins: Pufferfish, Cushion.Components

# ----
# Parameters for finger
L = Slider(119, range=50..150)
W = Slider(19, range=10..25)
H = Slider(20, range=10..20)
ncham = Slider(12, range=4..14)
wall = Slider(1.5, range=1.5..4)
bott = Slider(5, range=5..10)
slit = Slider(2, range=1..4)
palmw = Slider(60, range=0..100)
tipclear = Slider(8, range=0..100)

# ----
# Parameters for body
young_s_modulus = Slider(500, range=10..500)
nu = Slider(0.4, range=0.1..1)
mass = Slider(0.01, range=0.01..0.5)

range = Range(Domain=Domain(0, 1), Steps=expr("x-1", ncham))

# ----
# Orientation for gripper
expression = Expression(L=L, tipClear=tipclear, Expression="L + tipClear")
number_slider = Slider(90, range=0..100)
vector_xyz = VectorXYZ(XComponent=0, YComponent=expr("-x/2", palmw), ZComponent=expression)  # -> Translate, Length
vector_xyz_2 = VectorXYZ(XComponent=0, YComponent=expr("x/2", palmw), ZComponent=expression)  # -> Translate, Length
vector_xyz_3 = VectorXYZ(XComponent=expr("x*-1", number_slider), YComponent=number_slider, ZComponent=0)  # -> Vector, Length
vector_xyz_4 = VectorXYZ(XComponent=number_slider, YComponent=number_slider, ZComponent=0)  # -> Vector, Length

graph_mapper = GraphMapper(
    reverse(range),
    x0=0,
    x1=1,
    y0=0,
    y1=1,
    A=0,
    B=1,
    container_name="Linear",
    Graph_x0=0,
    Graph_x1=1,
    Graph_y0=1,
    Graph_y1=1)
createpneunet = CreatePneunet(L=L, W=W, H=H, ncham=ncham, wall=wall, bott=bott, slit=slit, profile=graph_mapper)  # -> body, cavity, strain_2, fix_2, mon

# ----
# Simplified collision model
unit_x = UnitX(Factor=expr("x*-1", 1))
unit_z = UnitZ(Factor=expr("x*-1", 1))
unit_x_2 = UnitX(Factor=1)
deconstruct_brep = DeconstructBrep(Brep=createpneunet.body)  # -> Faces, Edges, Vertices
remove_surface = RemoveSurface(B=createpneunet.body, dir=[unit_x_2, unit_x])
remove_surface_2 = RemoveSurface(B=createpneunet.body, dir=unit_z)
list_item = ListItem(List=deconstruct_brep.Faces, Index=remove_surface_2, Wrap=True)
list_item_2 = ListItem(List=deconstruct_brep.Faces, Index=flatten(remove_surface), Wrap=True)
merge = Merge(Data1=list_item, Data2=list_item_2)  # -> flatten(Result)
mesh = Mesh(merge)
triremesh = TriRemesh(Geometry=mesh, Iterations=25)  # -> Triangulation, Dual, Creases
reduce_mesh = ReduceMesh(Mesh=triremesh.Triangulation, FaceCount=20, Accuracy=1, FaceType=0, Distort=True, Normalize=False)  # -> Reduced, CountDifference
mesh_join = MeshJoin(Meshes=reduce_mesh.Reduced)

# ----
# Run/Refresh
# Results
refresh_sofapreview = Button()
refresh_sofaresults = Button()
refresh_sofashape = Button()
write_sofascene = BooleanToggle(True)
runsofa = Button()

# ----
# Set Repository
# Set runSofa Location
# Set Project Directory
repository = Panel("C:\Users\YOU\Documents\sofa-gh")
runsofa_location = Panel("C:\SOFA\SOFA_v24.06.00_Win64")
project_directory = Panel("C:\Users\YOU\Documents\sofa_projects\gripper")

mesh_brep = MeshBrep(
    Brep=createpneunet.strain_2,
    Settings={GridMaxCount=0, GridMinCount=16, JaggedSeams=False, MaxEdgeLength=0, MinEdgeLength=0.0001, MinTolerance=0, Refine=True, RefineAngle=0, RelativeTolerance=0.65, SimplePlanes=True, Tolerance=0})

# ----
# Cavity Meshing
triremesh_2 = TriRemesh(Geometry=createpneunet.cavity, Iterations=50)  # -> Triangulation, Dual, Creases
sofacavity = SofaCavity(Geometry=triremesh_2.Triangulation)

# ----
# Body Meshing
triremesh_3 = TriRemesh(Geometry=createpneunet.body, Iterations=50)  # -> Triangulation, Dual, Creases

sofaregion = SofaRegion(Geometry=mesh_brep, Name="layer", YoungsModulus=Slider(1000, range=0..1000), Repository=repository)  # -> Region, Shell

# ----
# Define Protocol
panel = Panel("""0,0,0
0,0,10
0,0,50""")
panel_2 = Panel("""0
.5
1""")
sofaprotocol = SofaProtocol(Times=panel_2, Offsets=panel)

N = Slider(10, range=0..10)
body_name = Panel("finger1")
body_name_2 = Panel("finger2")

# ----
# Define target
sphere = Sphere(Base=PlaneXY(0, 0, 21), Radius=19)
center_box = CenterBox(Base=PlaneXY(0, 0, 21), X=12, Y=12, Z=12)
brep = Brep(sphere)
triremesh_4 = TriRemesh(Geometry=brep, Iterations=25)  # -> Triangulation, Dual, Creases
reduce_mesh_2 = ReduceMesh(Mesh=triremesh_4.Triangulation, FaceCount=20, Accuracy=1, FaceType=0, Distort=True, Normalize=False)  # -> Reduced, CountDifference
sofatarget = SofaTarget(Geometry=reduce_mesh_2.Reduced, Name="object", Mass=0.005)

sofabody = SofaBody(
    Geometry=triremesh_3.Triangulation,
    BodyName=body_name,
    YoungsModulus=young_s_modulus,
    PoissonRatio=nu,
    Mass=mass,
    Cavities=sofacavity,
    Regions=sofaregion.Region,
    Fixations=createpneunet.fix_2,
    MonitorPoints=createpneunet.mon,
    CollisionGeometry=mesh_join,
    VisualGeometry=triremesh_3.Triangulation,
    MotionProtocol=sofaprotocol,
    RotateEuler=vector_xyz_4.Vector,
    Translate=vector_xyz.Translate,
    ExportShapeN=N)
sofabody_2 = SofaBody(
    Geometry=triremesh_3.Triangulation,
    BodyName=body_name_2,
    YoungsModulus=young_s_modulus,
    PoissonRatio=nu,
    Mass=mass,
    Cavities=sofacavity,
    Regions=sofaregion.Region,
    Fixations=createpneunet.fix_2,
    MonitorPoints=createpneunet.mon,
    CollisionGeometry=mesh_join,
    VisualGeometry=triremesh_3.Triangulation,
    MotionProtocol=sofaprotocol,
    RotateEuler=vector_xyz_3.Vector,
    Translate=vector_xyz_2.Translate,
    ExportShapeN=N)

# ----
# Optional mesh settings
gmshopts = Panel("""algo2d=MeshAdapt
algo3d=Delaunay
recomb=Blossom
smoothing=1
sizeFactor=0.5
order=1""")
meshsize = Slider(0.3, range=0..1)

merge_2 = Merge(Data1=sofabody, Data2=sofabody_2)

# ----
# Define pressure profile
values = Panel("""0
80
-20""")
times = Panel("""0
.5
1""")
pressureprofile = PressureProfile(Channel=1, Times=times, Values=values)

point = Point(Point(320, 0, 64))
point_2 = Point(Point(-94, 0, 42))
sofascene = SofaScene(
    Bodies=merge_2,
    Profiles=pressureprofile,
    Targets=sofatarget,
    CameraPosition=point,
    CameraLookAt=point_2,
    ProjectFolder=project_directory,
    FloorHeight="0",
    Write=write_sofascene)  # -> ScenePath, Info
frame = Slider(0, range=0..20)
sofaresults = SofaResults(ScenePath=sofascene.ScenePath, BodyName=body_name, RepoPath=repository, Refresh=refresh_sofaresults)  # -> Info, Times, TrackPoints, FinalPoints, NodeForces, ActuationTimes, Pressures, CableNames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
# Preview for setup
sofapreview = SofaPreview(ScenePath=sofascene.ScenePath, RepoPath=repository, Refresh=refresh_sofapreview)  # -> Volumes, Cavities, Regions, Targets, TendonCurves, TendonChannels, MonitorPoints, FixationBoxes, Info
# Preview for selected frame
sofashape = SofaShape(ScenePath=sofascene.ScenePath, BodyName=body_name_2, Frame=frame, RepoPath=repository, Refresh=refresh_sofashape)  # -> Mesh, FrameCount, Time, Info
sofashape_2 = SofaShape(ScenePath=sofascene.ScenePath, BodyName=body_name, Frame=frame, RepoPath=repository, Refresh=refresh_sofashape)  # -> Mesh, FrameCount, Time, Info
sofarun = SofaRun(ScenePath=sofascene.ScenePath, SOFAFolder=runsofa_location, RepoPath=repository, Run=runsofa)

# ==== cluster RemoveSurface
dir = ClusterInput()
B = ClusterInput()

list = ValueList({"North": 0, "South": 1, "East": 2, "West": 3, "Top": 4, "Bottom": 5}, selected="Bottom")
debrep = DeconstructBrep(Brep=B)  # -> Faces, Edges, Vertices
Y = UnitY(Factor=1)
X = UnitX(Factor=1)
Z = UnitZ(Factor=1)
rev = Reverse(Vector=Z)
rev_2 = Reverse(Vector=Y)
rev_3 = Reverse(Vector=X)
evalsrf = EvaluateSurface(Surface=reparameterize(debrep.Faces), Point="0.5,0.5,0")  # -> Point, Normal, UDirection, VDirection, Frame
filter = StreamFilter(Gate=list, Stream0=Y, Stream1=rev_2, Stream2=X, Stream3=rev_3, Stream4=Z, Stream5=rev)
mindex = MemberIndex(Set=evalsrf.Normal, Member=dir)  # -> Index, Count
item = ListItem(List=debrep.Faces, Index=mindex.Index, Wrap=True)
preview = CustomPreview(Geometry=item, Material=ColourSwatch(SwatchColor=RGB(186, 223, 255)))

I = ClusterOutput(mindex.Index)

# ==== cluster CreatePneunet
W = ClusterInput()
L = ClusterInput()
H = ClusterInput()
ncham = ClusterInput()
wall = ClusterInput()
bott = ClusterInput()
slit = ClusterInput()
profile = ClusterInput()
subtraction = Subtraction(A=H, BotT=bott)
finregion = Subtraction(A=L, B=8)
division = Division(FinRegion=finregion, NCham=ncham)
subtraction_2 = Subtraction(ChPitch=division, Slit=slit)
construct_domain = ConstructDomain(DomainStart=expr("0.2*x", subtraction), DomainEnd=subtraction)
expression = Expression(chPitch=division, Expression="4 + chPitch/2")
series = Series(Start=expr("x*.15", L), Step=expr(".8*x/5", L), Count=6)
remap_numbers = RemapNumbers(Profile=profile, Source=Domain(0, 1), Target=construct_domain)  # -> Mapped, Clipped
expression_2 = Expression(botT=bott, hi=remap_numbers.Mapped, wall=wall, Expression="botT + (hi - 2*wall - 0.5)/2")
expression_3 = Expression(botT=bott, hi=remap_numbers.Mapped, Expression="botT + hi/2")
series_2 = Series(Start=expression, Step=division, Count=ncham)
construct_point = ConstructPoint(XCoordinate=series_2, YCoordinate=0, ZCoordinate=expression_3)
construct_point_2 = ConstructPoint(XCoordinate=series_2, YCoordinate=0, ZCoordinate=expression_2)

# ----
# Strain Layer
construct_point_3 = ConstructPoint(XCoordinate=expr("x/2", L), YCoordinate=0, ZCoordinate=0.6)
center_box = CenterBox(Base=construct_point_3, X=expr("x/2+1", L), Y=expr("x/2+1", W), Z=0.8)

# ----
# Fixations
construct_point_4 = ConstructPoint(XCoordinate=2, YCoordinate=0, ZCoordinate=expr("x/2", H))
center_box_2 = CenterBox(Base=construct_point_4, X=4, Y=expr("x/2+2", W), Z=expr("x/2+2", H))

expression_4 = Expression(W=W, wall=wall, Expression="(W - 2*wall)/2")
construct_point_5 = ConstructPoint(XCoordinate=expr("x/2", L), YCoordinate=0, ZCoordinate=expr("x/2", bott))
expression_5 = Expression(finLen=subtraction_2, wall=wall, Expression="(finLen - 2*wall)/2")
construct_point_6 = ConstructPoint(XCoordinate=series, YCoordinate=0, ZCoordinate=expr("x+2", bott))
construct_point_7 = ConstructPoint(XCoordinate=expr("x/2", L), YCoordinate=0, ZCoordinate=expr("x/2", bott))
expression_6 = Expression(finRegion=finregion, slit=slit, Expression="(finRegion - slit)/2 - 2")
expression_7 = Expression(botT=bott, wall=wall, Expression="(botT - 2*wall)/2")
strain = Mesh(center_box)
fix = Mesh(center_box_2)
center_box_3 = CenterBox(Base=construct_point_2, X=expression_5, Y=expression_4, Z=expr("(x + 0.5)/2", remap_numbers.Mapped))
mon = ClusterOutput(construct_point_6)
reduce_mesh = ReduceMesh(Mesh=strain, FaceCount=20, Accuracy=1, FaceType=0, Distort=True, Normalize=False)  # -> Reduced, CountDifference
center_box_4 = CenterBox(Base=construct_point_7, X=expr("x/2", L), Y=expr("x/2", W), BotT=expr("x/2", bott))
center_box_5 = CenterBox(Base=construct_point, X=expr("x/2", subtraction_2), Y=expr("x/2", W), Z=expr("x/2", remap_numbers.Mapped))
reduce_mesh_2 = ReduceMesh(Mesh=fix, FaceCount=20, Accuracy=1, FaceType=0, Distort=True, Normalize=False)  # -> Reduced, CountDifference
merge = Merge(Data1=center_box_4, Data2=center_box_5)  # -> flatten(Result)
center_box_6 = CenterBox(Base=construct_point_5, X=expression_6, Y=1.5, Z=expression_7)
strain_2 = ClusterOutput(reduce_mesh.Reduced)
fix_2 = ClusterOutput(reduce_mesh_2.Reduced)
merge_2 = Merge(Data1=center_box_6, Data2=center_box_3)  # -> flatten(Result)
solid_union = SolidUnion(Breps=merge)
solid_union_2 = SolidUnion(Breps=merge_2)
body = ClusterOutput(solid_union)
cavity = ClusterOutput(solid_union_2)
